# Dynamo graph Autodesk Revit Dynamo Script.dyn "Final Script" (Dynamo 2.12.0.5650)
# packages: GenerativeDesign 1.7.3.0, spring nodes 204.1.0, Clockwork for Dynamo 2.x 2.3.0, Dynamo Text 2.0.1

# group: Input
number_of_major_roads_side_a = DoubleSlider(1, range=1..3 step 1)  # graph input
number_of_major_roads_side_b = DoubleSlider(2, range=1..4 step 1)  # graph input
major_road_width = DoubleSlider(12, range=0..20 step 1)

code_block = CodeBlock(a=number_of_major_roads_side_a) { a+1; }
code_block_2 = CodeBlock(a=number_of_major_roads_side_b) { a+1; }

# group: Getting Site Geometry
select_model_elements = DSModelElementsSelection()  # 4 picked in the model
curves = Element.Curves(element=select_model_elements)
remember = Data.Remember(curves)
startPoint = Curve.StartPoint(curve=remember)
flatten = List.Flatten(list=startPoint)
byPoints = Polygon.ByPoints(points=flatten)
byPatch = Surface.ByPatch(closedCurve=byPoints)
remember_2 = Data.Remember(curves)
flatten_2 = List.Flatten(list=remember_2)
code_block_3 = CodeBlock(siteboundarycurves=flatten_2) { siteboundarycurves; }

code_block_4 = CodeBlock(sitesurface=byPatch) { sitesurface; }
code_block_5 = CodeBlock(sitesurface=code_block_4) { sitesurface; }
code_block_6 = CodeBlock { 0; }
code_block_7 = CodeBlock { 1; }
code_block_8 = CodeBlock(a=number_of_major_roads_side_a) { 1/a; }
range = Range(start=code_block_6, end=code_block_7, step=code_block_8)

# group: Input
road_point_parameter_side_a = DoubleSlider(0.65, range=0.3..0.7 step 0.05)  # graph input
road_point_parameter_side_b = DoubleSlider(0.6, range=0.3..0.7 step 0.05)  # graph input

code_block_9 = CodeBlock { 0; }
code_block_10 = CodeBlock { 1; }
code_block_11 = CodeBlock(a=number_of_major_roads_side_b) { 1/a; }
range_2 = Range(start=code_block_9, end=code_block_10, step=code_block_11)
code_block_12 = CodeBlock(sitesurface=code_block_5) { sitesurface; }
code_block_13 = CodeBlock(sitesurface=code_block_12) { sitesurface; }
code_block_14 = CodeBlock { 2; 1; }
code_block_15 = CodeBlock { 2; 0; }

# group: Input
plot_length = DoubleSlider(20, range=0..100 step 0.1)
interior_road_width = DoubleSlider(10, range=0..20 step 1)
plot_width = DoubleSlider(15, range=0..100 step 0.1)
plot_offset = DoubleSlider(1, range=0..10 step 0)

# group: Local street Offset
code_block_16 = CodeBlock(plotlength=plot_length) { plotlength; }
code_block_17 = CodeBlock(a=code_block_16) { a*2; }
code_block_18 = CodeBlock(interiorroadwidth=interior_road_width) { interiorroadwidth; }
code_block_19 = CodeBlock(a=code_block_18) { a/2; }
code_block_20 = CodeBlock(a=code_block_17, b=code_block_19) { a+b; }
code_block_21 = CodeBlock(plotroadoffset=code_block_20) { plotroadoffset; }

code_block_22 = CodeBlock { 2; 1; }
code_block_23 = CodeBlock { 2; 0; }
code_block_24 = CodeBlock { 2; 1; }
code_block_25 = CodeBlock { 2; 1; }
code_block_26 = CodeBlock { 2; 1; }
code_block_27 = CodeBlock { 2; 1; }
code_block_28 = CodeBlock { 2; 0; }
code_block_29 = CodeBlock { 2; 1; }
code_block_30 = CodeBlock { 2; 1; }
code_block_31 = CodeBlock(interiorroadwidth=code_block_18) { interiorroadwidth; }
code_block_32 = CodeBlock(a=code_block_31) { a/2; }
code_block_33 = CodeBlock(a=code_block_32) { a*-1; }
code_block_34 = CodeBlock { 4; 3; }
code_block_35 = CodeBlock { 1; }
code_block_36 = CodeBlock { 3; }
code_block_37 = CodeBlock { 4; }
code_block_38 = CodeBlock { -1; }
code_block_39 = CodeBlock(siteboundary=byPoints) { siteboundary; }
school_area = DoubleSlider(4000, range=0..5000 step 1)
code_block_40 = CodeBlock { 2; 0; 1; }
code_block_41 = CodeBlock { -1; }
code_block_42 = CodeBlock { 1; }
code_block_43 = CodeBlock { 1; }
code_block_44 = CodeBlock { 3; }
code_block_45 = CodeBlock(plotwidth=plot_width) { plotwidth; }
code_block_46 = CodeBlock { 2; 0; }
code_block_47 = CodeBlock { 2; 1; }
boolean = BoolSelector(false)
code_block_48 = CodeBlock { 1; }
code_block_49 = CodeBlock { 1; }
boolean_2 = BoolSelector(true)
code_block_50 = CodeBlock { 2; 0; 1; }
code_block_51 = CodeBlock { 4; }
join = List.Join()  # unwired: list0, list1
code_block_52 = CodeBlock { 2; 0; 1; }
code_block_53 = CodeBlock { 4; }
join_2 = List.Join()  # unwired: list0, list1
code_block_54 = CodeBlock { 3; }
code_block_55 = CodeBlock { 0; }
code_block_56 = CodeBlock { 3; }
code_block_57 = CodeBlock { 0; }
code_block_58 = CodeBlock(a=plot_offset) { a*-1; }
code_block_59 = CodeBlock { 2; 0; }
code_block_60 = CodeBlock { -10; }
ZAxis = Vector.ZAxis()
code_block_61 = CodeBlock { 9; }
color_palette = ColorPalette({R: 0, G: 0, B: 0, A: 190})
code_block_62 = CodeBlock { ["1. % Open Space", "2. No. of Plot", "3. % Road Area", "Proximity to School", "Proximity to Open space", "Shadow %"]; }
code_block_63 = CodeBlock { 10; }
code_block_64 = CodeBlock { ["Percentage Open Space", "Number of Plots", "Percentage Road Area", "Proximity to School", "Proximity to Open space", "Percentage Shadow"]; }

# group: Side A Major Roads
code_block_65 = CodeBlock { 2; }
getItemAtIndex = List.GetItemAtIndex(list=code_block_3, index=code_block_65)
splitByParameter = Curve.SplitByParameter(curve=getItemAtIndex, parameters=range)
pointAtParameter = Curve.PointAtParameter(curve=splitByParameter, param=road_point_parameter_side_a)
code_block_66 = CodeBlock { 0; }
getItemAtIndex_2 = List.GetItemAtIndex(list=code_block_3, index=code_block_66)

# group: Side B Major Roads
code_block_67 = CodeBlock { 1; }
getItemAtIndex_3 = List.GetItemAtIndex(list=code_block_3, index=code_block_67)
code_block_68 = CodeBlock { 3; }
getItemAtIndex_4 = List.GetItemAtIndex(list=code_block_3, index=code_block_68)
startPoint_2 = Curve.StartPoint(curve=getItemAtIndex_2)
endPoint = Curve.EndPoint(curve=getItemAtIndex_2)
byTwoPoints = Vector.ByTwoPoints(start=startPoint_2, end=endPoint)

# group (continued): Side A Major Roads
startPoint_3 = Curve.StartPoint(curve=getItemAtIndex_3)
endPoint_2 = Curve.EndPoint(curve=getItemAtIndex_3)
byTwoPoints_2 = Vector.ByTwoPoints(start=startPoint_3, end=endPoint_2)
project = Point.Project(point=pointAtParameter, baseGeometry=getItemAtIndex_2, projectionDirection=byTwoPoints_2)

byStartPointEndPoint = Line.ByStartPointEndPoint(startPoint=pointAtParameter, endPoint=project)

# group: Road width _ side A
code_block_69 = CodeBlock(a=major_road_width) { a/2; }
offset = Curve.Offset(curve=byStartPointEndPoint, distance=code_block_69)
code_block_70 = CodeBlock(a=code_block_69) { a*-1; }
offset_2 = Curve.Offset(curve=byStartPointEndPoint, distance=code_block_70)

# group: Side A Road polygon
list_create = List.Create(item0=offset, item1=offset_2)
transpose = List.Transpose(lists=list_create)
flatten_3 = List.Flatten(list=transpose)
startPoint_4 = Curve.StartPoint(curve=flatten_3)
endPoint_3 = Curve.EndPoint(curve=flatten_3)
list_create_2 = List.Create(item0=startPoint_4, item1=endPoint_3)
transpose_2 = List.Transpose(lists=list_create_2)
flatten_4 = List.Flatten(list=transpose_2)
code_block_71 = CodeBlock { 4; 3; }
dropEveryNthItem = List.DropEveryNthItem(list=flatten_4, n=code_block_71.out0, offset=code_block_71.out1)
code_block_72 = CodeBlock { 3; }
chop = List.Chop(list=dropEveryNthItem, lengths=code_block_72)
takeEveryNthItem = List.TakeEveryNthItem(list=flatten_4, n=code_block_71.out0, offset=code_block_71.out1)
code_block_73 = CodeBlock { 1; }
chop_2 = List.Chop(list=takeEveryNthItem, lengths=code_block_73)
list_create_3 = List.Create(item0=chop, item1=chop_2)
transpose_3 = List.Transpose(lists=list_create_3)
flatten_5 = List.Flatten(list=transpose_3)
code_block_74 = CodeBlock { 4; }
chop_3 = List.Chop(list=flatten_5, lengths=code_block_74)
byPoints_2 = Polygon.ByPoints(points=chop_3)

splitByParameter_2 = Curve.SplitByParameter(curve=getItemAtIndex_3, parameters=range_2)

# group (continued): Side B Major Roads
pointAtParameter_2 = Curve.PointAtParameter(curve=splitByParameter_2, param=road_point_parameter_side_b)
project_2 = Point.Project(point=pointAtParameter_2, baseGeometry=getItemAtIndex_4, projectionDirection=byTwoPoints)

byStartPointEndPoint_2 = Line.ByStartPointEndPoint(startPoint=pointAtParameter_2, endPoint=project_2)

# group: Road width _ side B
code_block_75 = CodeBlock(a=major_road_width) { a/2; }
offset_3 = Curve.Offset(curve=byStartPointEndPoint_2, distance=code_block_75)
code_block_76 = CodeBlock(a=code_block_75) { a*-1; }
offset_4 = Curve.Offset(curve=byStartPointEndPoint_2, distance=code_block_76)

# group: Side B Road polygon
list_create_4 = List.Create(item0=offset_3, item1=offset_4)
transpose_4 = List.Transpose(lists=list_create_4)
flatten_6 = List.Flatten(list=transpose_4)
startPoint_5 = Curve.StartPoint(curve=flatten_6)
endPoint_4 = Curve.EndPoint(curve=flatten_6)
list_create_5 = List.Create(item0=startPoint_5, item1=endPoint_4)
transpose_5 = List.Transpose(lists=list_create_5)
flatten_7 = List.Flatten(list=transpose_5)
code_block_77 = CodeBlock { 4; 3; }
dropEveryNthItem_2 = List.DropEveryNthItem(list=flatten_7, n=code_block_77.out0, offset=code_block_77.out1)
code_block_78 = CodeBlock { 3; }
chop_4 = List.Chop(list=dropEveryNthItem_2, lengths=code_block_78)
takeEveryNthItem_2 = List.TakeEveryNthItem(list=flatten_7, n=code_block_77.out0, offset=code_block_77.out1)
code_block_79 = CodeBlock { 1; }
chop_5 = List.Chop(list=takeEveryNthItem_2, lengths=code_block_79)
list_create_6 = List.Create(item0=chop_4, item1=chop_5)
transpose_6 = List.Transpose(lists=list_create_6)
flatten_8 = List.Flatten(list=transpose_6)
code_block_80 = CodeBlock { 4; }
chop_6 = List.Chop(list=flatten_8, lengths=code_block_80)
byPoints_3 = Polygon.ByPoints(points=chop_6)

# group: Major Road Surfaces
byPatch_2 = Surface.ByPatch(closedCurve=byPoints_2)
byPatch_3 = Surface.ByPatch(closedCurve=byPoints_3)
list_create_7 = List.Create(item0=byPatch_2, item1=byPatch_3)
flatten_9 = List.Flatten(list=list_create_7)
byUnion = Surface.ByUnion(surfaces=flatten_9)

# group: Major Plot Surfaces
split = Geometry.Split(geometry=code_block_5, other=byUnion)
code_block_81 = CodeBlock { -1; }
dropItems = List.DropItems(list=split, amount=code_block_81)

# group: Major Plots - Find Shorter Side
perimeterCurves = Surface.PerimeterCurves(surface=dropItems)
length = Curve.Length(curve=perimeterCurves)
round = Math.Round(number=length)
maximumItem = List.MaximumItem(list=round)
eq = maximumItem == round
filterByBoolMask = List.FilterByBoolMask(list=perimeterCurves, mask=eq)
flatten_10 = List.Flatten(list=filterByBoolMask.in)
code_block_82 = CodeBlock { 2; 0; }
takeEveryNthItem_3 = List.TakeEveryNthItem(list=flatten_10, n=code_block_82.out0, offset=code_block_82.out1)

# group: Plot Divider
length_2 = Curve.Length(curve=takeEveryNthItem_3)
plot_divider = DoubleSlider(66, range=0..150 step 1)
code_block_83 = CodeBlock(a=length_2, b=plot_divider) { a/b; }
code_block_84 = CodeBlock(a=code_block_83) { 0; 1; 1/a; }
range_3 = Range(start=code_block_84.out0, end=code_block_84.out1, step=code_block_84.out2)
code_block_85 = CodeBlock { 0; }
eq_2 = range_3 == code_block_85
filterByBoolMask_2 = List.FilterByBoolMask(list=range_3, mask=eq_2)
code_block_86 = CodeBlock { 0.8; }
ge = filterByBoolMask_2.out >= code_block_86
filterByBoolMask_3 = List.FilterByBoolMask(list=filterByBoolMask_2.out, mask=ge)

pointAtParameter_3 = Curve.PointAtParameter(curve=takeEveryNthItem_3, param=filterByBoolMask_3.out)
code_block_87 = CodeBlock(MajorRoads=byUnion) { MajorRoads; }
code_block_88 = CodeBlock(MajorRoads=code_block_87) { MajorRoads; }
pointAtSegmentLength = Curve.PointAtSegmentLength(curve=takeEveryNthItem_3, segmentLength=plot_divider)
takeEveryNthItem_4 = List.TakeEveryNthItem(list=flatten_10, n=code_block_14.out0, offset=code_block_14.out1)

# group: Shorter Lines for Vector
flatten_11 = List.Flatten(list=filterByBoolMask.out)
code_block_89 = CodeBlock { 2; 1; }
takeEveryNthItem_5 = List.TakeEveryNthItem(list=flatten_11, n=code_block_89.out0, offset=code_block_89.out1)
startPoint_6 = Curve.StartPoint(curve=takeEveryNthItem_5)
endPoint_5 = Curve.EndPoint(curve=takeEveryNthItem_5)
byTwoPoints_3 = Vector.ByTwoPoints(start=startPoint_6, end=endPoint_5)
code_block_90 = CodeBlock { 2; 0; }
takeEveryNthItem_6 = List.TakeEveryNthItem(list=flatten_11, n=code_block_90.out0, offset=code_block_90.out1)
startPoint_7 = Curve.StartPoint(curve=takeEveryNthItem_6)
endPoint_6 = Curve.EndPoint(curve=takeEveryNthItem_6)
byTwoPoints_4 = Vector.ByTwoPoints(start=startPoint_7, end=endPoint_6)

project_3 = Point.Project(point=pointAtSegmentLength, baseGeometry=takeEveryNthItem_4, projectionDirection=byTwoPoints_3)
byStartPointEndPoint_3 = Line.ByStartPointEndPoint(startPoint=project_3, endPoint=pointAtSegmentLength)
project_4 = Point.Project(point=pointAtSegmentLength, baseGeometry=takeEveryNthItem_4, projectionDirection=byTwoPoints_4)
byStartPointEndPoint_4 = Line.ByStartPointEndPoint(startPoint=project_4, endPoint=pointAtSegmentLength)
list_create_8 = List.Create(item0=byStartPointEndPoint_3, item1=byStartPointEndPoint_4)
code_block_91 = CodeBlock(DIVIDINGROADS=list_create_8) { DIVIDINGROADS; }
flatten_12 = List.Flatten(list=code_block_91)
code_block_92 = CodeBlock(majorplots=dropItems) { majorplots; }
split_2 = Geometry.Split(geometry=code_block_92, other=byStartPointEndPoint_3)
split_3 = Geometry.Split(geometry=code_block_92, other=byStartPointEndPoint_4)
list_create_9 = List.Create(item0=split_2, item1=split_3)
flatten_13 = List.Flatten(list=list_create_9)
takeEveryNthItem_7 = List.TakeEveryNthItem(list=flatten_13, n=code_block_15.out0, offset=code_block_15.out1)

# group: Cut Plot 1- Bigger Plot - Find Shorter Side
perimeterCurves_2 = Surface.PerimeterCurves(surface=takeEveryNthItem_7)
length_3 = Curve.Length(curve=perimeterCurves_2)
round_2 = Math.Round(number=length_3)
maximumItem_2 = List.MaximumItem(list=round_2)
eq_3 = maximumItem_2 == round_2
filterByBoolMask_4 = List.FilterByBoolMask(list=perimeterCurves_2, mask=eq_3)
flatten_14 = List.Flatten(list=filterByBoolMask_4.in)
code_block_93 = CodeBlock { 2; 0; }
takeEveryNthItem_8 = List.TakeEveryNthItem(list=flatten_14, n=code_block_93.out0, offset=code_block_93.out1)

# group: Road divisions - Finding Dividing Points
length_4 = Curve.Length(curve=takeEveryNthItem_8)
code_block_94 = CodeBlock { 3; }
round_3 = Math.Round(number=length_4, digits=code_block_94)
code_block_95 = CodeBlock(a=round_3, b=code_block_21) { a/b; }
code_block_96 = CodeBlock { 3; }
round_4 = Math.Round(number=code_block_95, digits=code_block_96)
code_block_97 = CodeBlock(a=round_4) { 0; 1; 1/a; }
range_4 = Range(start=code_block_97.out0, end=code_block_97.out1, step=code_block_97.out2)
code_block_98 = CodeBlock { 0; }
eq_4 = range_4 == code_block_98
filterByBoolMask_5 = List.FilterByBoolMask(list=range_4, mask=eq_4)
code_block_99 = CodeBlock { 3; }
round_5 = Math.Round(number=filterByBoolMask_5.out, digits=code_block_99)
code_block_100 = CodeBlock { 0.8; }
ge_2 = round_5 >= code_block_100
filterByBoolMask_6 = List.FilterByBoolMask(list=round_5, mask=ge_2)

pointAtParameter_4 = Curve.PointAtParameter(curve=takeEveryNthItem_8, param=filterByBoolMask_6.out)
takeEveryNthItem_9 = List.TakeEveryNthItem(list=flatten_14, n=code_block_22.out0, offset=code_block_22.out1)
flatten_15 = List.Flatten(list=filterByBoolMask_4.out)
takeEveryNthItem_10 = List.TakeEveryNthItem(list=flatten_15, n=code_block_23.out0, offset=code_block_23.out1)
startPoint_8 = Curve.StartPoint(curve=takeEveryNthItem_10)
endPoint_7 = Curve.EndPoint(curve=takeEveryNthItem_10)
byTwoPoints_5 = Vector.ByTwoPoints(start=startPoint_8, end=endPoint_7)
project_5 = Point.Project(point=pointAtParameter_4, baseGeometry=takeEveryNthItem_9, projectionDirection=byTwoPoints_5)
takeEveryNthItem_11 = List.TakeEveryNthItem(list=flatten_14, n=code_block_24.out0, offset=code_block_24.out1)
flatten_16 = List.Flatten(list=filterByBoolMask_4.out)
takeEveryNthItem_12 = List.TakeEveryNthItem(list=flatten_16, n=code_block_25.out0, offset=code_block_25.out1)
startPoint_9 = Curve.StartPoint(curve=takeEveryNthItem_12)
endPoint_8 = Curve.EndPoint(curve=takeEveryNthItem_12)
byTwoPoints_6 = Vector.ByTwoPoints(start=startPoint_9, end=endPoint_8)
project_6 = Point.Project(point=pointAtParameter_4, baseGeometry=takeEveryNthItem_11, projectionDirection=byTwoPoints_6)
takeEveryNthItem_13 = List.TakeEveryNthItem(list=flatten_13, n=code_block_26.out0, offset=code_block_26.out1)

# group: CutPlots 2 - Smaller - Find Shorter Side
perimeterCurves_3 = Surface.PerimeterCurves(surface=takeEveryNthItem_13)
length_5 = Curve.Length(curve=perimeterCurves_3)
round_6 = Math.Round(number=length_5)
maximumItem_3 = List.MaximumItem(list=round_6)
eq_5 = maximumItem_3 == round_6
filterByBoolMask_7 = List.FilterByBoolMask(list=perimeterCurves_3, mask=eq_5)
flatten_17 = List.Flatten(list=filterByBoolMask_7.in)
code_block_101 = CodeBlock { 2; 0; }
takeEveryNthItem_14 = List.TakeEveryNthItem(list=flatten_17, n=code_block_101.out0, offset=code_block_101.out1)

# group: Road divisions - Finding Dividing Points
length_6 = Curve.Length(curve=takeEveryNthItem_14)
code_block_102 = CodeBlock { 3; }
round_7 = Math.Round(number=length_6, digits=code_block_102)
code_block_103 = CodeBlock(a=round_7, b=code_block_21) { a/b; }
code_block_104 = CodeBlock { 3; }
round_8 = Math.Round(number=code_block_103, digits=code_block_104)
code_block_105 = CodeBlock(a=round_8) { 0; 1; 1/a; }
range_5 = Range(start=code_block_105.out0, end=code_block_105.out1, step=code_block_105.out2)
code_block_106 = CodeBlock { 0; }
eq_6 = range_5 == code_block_106
filterByBoolMask_8 = List.FilterByBoolMask(list=range_5, mask=eq_6)
code_block_107 = CodeBlock { 3; }
round_9 = Math.Round(number=filterByBoolMask_8.out, digits=code_block_107)
code_block_108 = CodeBlock { 0.8; }
ge_3 = round_9 >= code_block_108
filterByBoolMask_9 = List.FilterByBoolMask(list=round_9, mask=ge_3)

pointAtParameter_5 = Curve.PointAtParameter(curve=takeEveryNthItem_14, param=filterByBoolMask_9.out)
takeEveryNthItem_15 = List.TakeEveryNthItem(list=flatten_17, n=code_block_27.out0, offset=code_block_27.out1)
flatten_18 = List.Flatten(list=filterByBoolMask_7.out)
takeEveryNthItem_16 = List.TakeEveryNthItem(list=flatten_18, n=code_block_28.out0, offset=code_block_28.out1)
startPoint_10 = Curve.StartPoint(curve=takeEveryNthItem_16)
endPoint_9 = Curve.EndPoint(curve=takeEveryNthItem_16)
byTwoPoints_7 = Vector.ByTwoPoints(start=startPoint_10, end=endPoint_9)
project_7 = Point.Project(point=pointAtParameter_5, baseGeometry=takeEveryNthItem_15, projectionDirection=byTwoPoints_7)
pointAtParameter_6 = Curve.PointAtParameter(curve=takeEveryNthItem_14, param=filterByBoolMask_9.out)
takeEveryNthItem_17 = List.TakeEveryNthItem(list=flatten_17, n=code_block_29.out0, offset=code_block_29.out1)
flatten_19 = List.Flatten(list=filterByBoolMask_7.out)
takeEveryNthItem_18 = List.TakeEveryNthItem(list=flatten_19, n=code_block_30.out0, offset=code_block_30.out1)
startPoint_11 = Curve.StartPoint(curve=takeEveryNthItem_18)
endPoint_10 = Curve.EndPoint(curve=takeEveryNthItem_18)
byTwoPoints_8 = Vector.ByTwoPoints(start=startPoint_11, end=endPoint_10)
project_8 = Point.Project(point=pointAtParameter_6, baseGeometry=takeEveryNthItem_17, projectionDirection=byTwoPoints_8)

# group: All Interior Road Segemnts
code_block_109 = CodeBlock(DIVIDINGROADS=flatten_12) { DIVIDINGROADS; }
byStartPointEndPoint_5 = Line.ByStartPointEndPoint(startPoint=project_5, endPoint=pointAtParameter_4)
byStartPointEndPoint_6 = Line.ByStartPointEndPoint(startPoint=project_6, endPoint=pointAtParameter_4)
byStartPointEndPoint_7 = Line.ByStartPointEndPoint(startPoint=project_7, endPoint=pointAtParameter_5)
byStartPointEndPoint_8 = Line.ByStartPointEndPoint(startPoint=pointAtParameter_6, endPoint=project_8)

flatten_20 = List.Flatten(list=byStartPointEndPoint_5)
flatten_21 = List.Flatten(list=byStartPointEndPoint_6)
flatten_22 = List.Flatten(list=byStartPointEndPoint_7)
flatten_23 = List.Flatten(list=byStartPointEndPoint_8)
list_create_10 = List.Create(item0=code_block_109, item1=flatten_20, item2=flatten_21, item3=flatten_22, item4=flatten_23)
flatten_24 = List.Flatten(list=list_create_10)
offset_5 = Curve.Offset(curve=flatten_24, distance=code_block_32)
offset_6 = Curve.Offset(curve=flatten_24, distance=code_block_33)
list_create_11 = List.Create(item0=offset_5, item1=offset_6)
transpose_7 = List.Transpose(lists=list_create_11)
flatten_25 = List.Flatten(list=transpose_7)
startPoint_12 = Curve.StartPoint(curve=flatten_25)
endPoint_11 = Curve.EndPoint(curve=flatten_25)
list_create_12 = List.Create(item0=startPoint_12, item1=endPoint_11)
transpose_8 = List.Transpose(lists=list_create_12)
flatten_26 = List.Flatten(list=transpose_8)
takeEveryNthItem_19 = List.TakeEveryNthItem(list=flatten_26, n=code_block_34.out0, offset=code_block_34.out1)
chop_7 = List.Chop(list=takeEveryNthItem_19, lengths=code_block_35)
dropEveryNthItem_3 = List.DropEveryNthItem(list=flatten_26, n=code_block_34.out0, offset=code_block_34.out1)
chop_8 = List.Chop(list=dropEveryNthItem_3, lengths=code_block_36)
list_create_13 = List.Create(item0=chop_7, item1=chop_8)
transpose_9 = List.Transpose(lists=list_create_13)
flatten_27 = List.Flatten(list=transpose_9)
chop_9 = List.Chop(list=flatten_27, lengths=code_block_37)
byPoints_4 = Polygon.ByPoints(points=chop_9)
byPatch_4 = Surface.ByPatch(closedCurve=byPoints_4)
code_block_110 = CodeBlock(interiorroads=byPatch_4) { interiorroads; }
list_create_14 = List.Create(item0=code_block_88, item1=code_block_110)
flatten_28 = List.Flatten(list=list_create_14)
byUnion_2 = Surface.ByUnion(surfaces=flatten_28)
split_4 = Geometry.Split(geometry=code_block_12, other=byUnion_2)
dropItems_2 = List.DropItems(list=split_4, amount=code_block_38)
code_block_111 = CodeBlock(Innerplotssurfaces=dropItems_2) { Innerplotssurfaces; }

# group: School
code_block_112 = CodeBlock(Innerplotssurfaces=code_block_111) { Innerplotssurfaces; }
code_block_113 = CodeBlock(siteboundary=code_block_39) { siteboundary; }
center = Polygon.Center(polygon=code_block_113)
closestPointTo = Geometry.ClosestPointTo(geometry=code_block_112, other=center)
byStartPointEndPoint_9 = Line.ByStartPointEndPoint(startPoint=center, endPoint=closestPointTo)
length_7 = Curve.Length(curve=byStartPointEndPoint_9)
minimumItem = List.MinimumItem(list=length_7)
eq_7 = length_7 == minimumItem
filterByBoolMask_10 = List.FilterByBoolMask(list=code_block_112, mask=eq_7)
deconstruct = List.Deconstruct(list=filterByBoolMask_10.in)

perimeterCurves_4 = Surface.PerimeterCurves(surface=deconstruct.first)
length_8 = Curve.Length(curve=perimeterCurves_4)

# group: Condition for dividing school plot
maximumItem_4 = List.MaximumItem(list=length_8)
round_10 = Math.Round(number=maximumItem_4)
minimumItem_2 = List.MinimumItem(list=length_8)
round_11 = Math.Round(number=minimumItem_2)
div = school_area / round_11
code_block_114 = CodeBlock(plotwidth=plot_width) { plotwidth; }
code_block_115 = CodeBlock(a=div, b=code_block_114) { a+(2*b); }
gt = round_10 > code_block_115

# group: Center Line of School Plot
eq_8 = length_8 == maximumItem_4
filterByBoolMask_11 = List.FilterByBoolMask(list=perimeterCurves_4, mask=eq_8)
flatten_29 = List.Flatten(list=filterByBoolMask_11.in)
code_block_116 = CodeBlock { 2; 0; 1; }
takeEveryNthItem_20 = List.TakeEveryNthItem(list=flatten_29, n=code_block_116.out0, offset=code_block_116.out1)
number_slider = DoubleSlider(0.5, range=0..1 step 0.1)
pointAtParameter_7 = Curve.PointAtParameter(curve=takeEveryNthItem_20, param=number_slider)
takeEveryNthItem_21 = List.TakeEveryNthItem(list=flatten_29, n=code_block_116.out0, offset=code_block_116.out2)
flatten_30 = List.Flatten(list=filterByBoolMask_11.out)
takeEveryNthItem_22 = List.TakeEveryNthItem(list=flatten_30, n=code_block_116.out0, offset=code_block_116.out1)
startPoint_13 = Curve.StartPoint(curve=takeEveryNthItem_22)
endPoint_12 = Curve.EndPoint(curve=takeEveryNthItem_22)
byTwoPoints_9 = Vector.ByTwoPoints(start=startPoint_13, end=endPoint_12)

flatten_31 = List.Flatten(list=filterByBoolMask_11.out)
takeEveryNthItem_23 = List.TakeEveryNthItem(list=flatten_31, n=code_block_40.out0, offset=code_block_40.out2)
startPoint_14 = Curve.StartPoint(curve=takeEveryNthItem_23)
endPoint_13 = Curve.EndPoint(curve=takeEveryNthItem_23)
byTwoPoints_10 = Vector.ByTwoPoints(start=startPoint_14, end=endPoint_13)
clean = List.Clean(list=byTwoPoints_10)
flatten_32 = List.Flatten(list=clean)
project_9 = Point.Project(point=pointAtParameter_7, baseGeometry=takeEveryNthItem_21, projectionDirection=flatten_32)
clean_2 = List.Clean(list=byTwoPoints_9)
flatten_33 = List.Flatten(list=clean_2)

# group (continued): Center Line of School Plot
project_10 = Point.Project(point=pointAtParameter_7, baseGeometry=takeEveryNthItem_21, projectionDirection=flatten_33)

list_create_15 = List.Create(item0=project_9, item1=project_10)
flatten_34 = List.Flatten(list=list_create_15)
clean_3 = List.Clean(list=flatten_34)

# group (continued): Center Line of School Plot
byStartPointEndPoint_10 = Line.ByStartPointEndPoint(startPoint=clean_3, endPoint=pointAtParameter_7)

code_block_117 = CodeBlock(a=div) { a/2; }
offset_7 = Curve.Offset(curve=byStartPointEndPoint_10, distance=code_block_117)
startPoint_15 = Curve.StartPoint(curve=offset_7)
endPoint_14 = Curve.EndPoint(curve=offset_7)
code_block_118 = CodeBlock(a=code_block_117) { a*-1; }
offset_8 = Curve.Offset(curve=byStartPointEndPoint_10, distance=code_block_118)
endPoint_15 = Curve.EndPoint(curve=offset_8)
startPoint_16 = Curve.StartPoint(curve=offset_8)
list_create_16 = List.Create(item0=startPoint_15, item1=endPoint_14, item2=endPoint_15, item3=startPoint_16)
flatten_35 = List.Flatten(list=list_create_16)
byPoints_5 = Polygon.ByPoints(points=flatten_35)
byPatch_5 = Surface.ByPatch(closedCurve=byPoints_5)
split_5 = Geometry.Split(geometry=deconstruct.first, other=byPatch_5)
flatten_36 = List.Flatten(list=split_5)
dropItems_3 = List.DropItems(list=flatten_36, amount=code_block_41)
list_create_17 = List.Create(item0=dropItems_3)
code_block_119 = CodeBlock(a=gt, b=list_create_17) { (a?b:c); }  # unwired: c
flatten_37 = List.Flatten(list=code_block_119)
list_create_18 = List.Create(item0=deconstruct.rest, item1=filterByBoolMask_10.out, item2=flatten_37)
flatten_38 = List.Flatten(list=list_create_18)

# group: Open Spaces
code_block_120 = CodeBlock(majorplots=code_block_92) { majorplots; }
boundingBox = Geometry.BoundingBox(geometry=code_block_120)
ꟿ_boundingbox_midpoint = Custom[ꟿ BoundingBox.MidPoint](boundingBox=boundingBox)  # package spring nodes; Fetches the mid point of the bounding box.
list_create_19 = List.Create(item0=ꟿ_boundingbox_midpoint)
code_block_121 = CodeBlock(AllRoadSurfaces=byUnion_2) { AllRoadSurfaces; }
area = Surface.Area(surface=code_block_111)
sum = Math.Sum(values=area)

closestPointTo_2 = Geometry.ClosestPointTo(geometry=flatten_38, other=list_create_19, lacing=CrossProduct)
flatten_39 = List.Flatten(list=closestPointTo_2, amount=code_block_42)
transpose_10 = List.Transpose(lists=flatten_39)
byStartPointEndPoint_11 = Line.ByStartPointEndPoint(startPoint=ꟿ_boundingbox_midpoint, endPoint=transpose_10@L3)
length_9 = Curve.Length(curve=byStartPointEndPoint_11)
minimumItem_3 = List.MinimumItem(list=length_9)
eq_9 = length_9 == minimumItem_3
flatten_40 = List.Flatten(list=eq_9, amount=code_block_43)
filterByBoolMask_12 = List.FilterByBoolMask(list=transpose_10, mask=flatten_40)
list_create_20 = List.Create(item0=filterByBoolMask_12.in)
flatten_41 = List.Flatten(list=list_create_20)
list_create_21 = List.Create(item0=flatten_41)

# group (continued): Open Spaces
doesIntersect = Geometry.DoesIntersect(geometry=flatten_38, other=list_create_21, lacing=CrossProduct)
anyTrue = Custom[Booleans.AnyTrue](seq=doesIntersect)  # package Clockwork for Dynamo 2.x; Returns true if any item in a list of booleans is true.
flatten_42 = List.Flatten(list=anyTrue)
filterByBoolMask_13 = List.FilterByBoolMask(list=flatten_38, mask=flatten_42)
list_create_22 = List.Create(item0=filterByBoolMask_13.in)
area_2 = Surface.Area(surface=list_create_22)
sum_2 = Math.Sum(values=area_2)
code_block_122 = CodeBlock(a=sum_2, b=sum) { (a/b)*100; }

code_block_123 = CodeBlock(plotsurface=filterByBoolMask_13.out) { plotsurface; }
byUnion_3 = Surface.ByUnion(surfaces=code_block_123)

# group: Individual land Parcels
perimeterCurves_5 = Surface.PerimeterCurves(surface=filterByBoolMask_13.out)
length_10 = Curve.Length(curve=perimeterCurves_5)
maximumItem_5 = List.MaximumItem(list=length_10)
eq_10 = maximumItem_5 == length_10
filterByBoolMask_14 = List.FilterByBoolMask(list=perimeterCurves_5, mask=eq_10)
flatten_43 = List.Flatten(list=filterByBoolMask_14.in)
code_block_124 = CodeBlock { 0; 1; 2; }
dropEveryNthItem_4 = List.DropEveryNthItem(list=flatten_43, n=code_block_124.out2, offset=code_block_124.out0)
dropEveryNthItem_5 = List.DropEveryNthItem(list=flatten_43, n=code_block_124.out2, offset=code_block_124.out1)

# group: Boundary Polygons
code_block_125 = CodeBlock(perimetercurves=perimeterCurves_5) { perimetercurves; }
endPoint_16 = Curve.EndPoint(curve=code_block_125)
flatten_44 = List.Flatten(list=endPoint_16)
startPoint_17 = Curve.StartPoint(curve=code_block_125)
flatten_45 = List.Flatten(list=startPoint_17)
list_create_23 = List.Create(item0=endPoint_16, item1=startPoint_17)
transpose_11 = List.Transpose(lists=list_create_23)
byPoints_6 = Polygon.ByPoints(points=transpose_11)
flatten_46 = List.Flatten(list=byPoints_6)
code_block_126 = CodeBlock { 2; 0; }
takeEveryNthItem_24 = List.TakeEveryNthItem(list=flatten_46, n=code_block_126.out0, offset=code_block_126.out1)

length_11 = Curve.Length(curve=dropEveryNthItem_4)
round_12 = Math.Round(number=length_11, digits=code_block_44)
code_block_127 = CodeBlock(a=round_12, b=code_block_45) { a/b; 0; }

# group: Plot division points
round_13 = Math.Round(number=code_block_127.out0, digits=code_block_127.out1)
code_block_128 = CodeBlock(a=round_13) { 0; 1; 1/a; }
range_6 = Range(start=code_block_128.out0, end=code_block_128.out1, step=code_block_128.out2)
code_block_129 = CodeBlock { 0; }
eq_11 = range_6 == code_block_129
filterByBoolMask_15 = List.FilterByBoolMask(list=range_6, mask=eq_11)
code_block_130 = CodeBlock { 3; }
round_14 = Math.Round(number=filterByBoolMask_15.out, digits=code_block_130)
code_block_131 = CodeBlock { 1; }
eq_12 = round_14 == code_block_131
filterByBoolMask_16 = List.FilterByBoolMask(list=round_14, mask=eq_12)

pointAtParameter_8 = Curve.PointAtParameter(curve=dropEveryNthItem_4, param=filterByBoolMask_16.out)
flatten_47 = List.Flatten(list=filterByBoolMask_14.out)
dropEveryNthItem_6 = List.DropEveryNthItem(list=flatten_47, n=code_block_46.out0, offset=code_block_46.out1)
startPoint_18 = Curve.StartPoint(curve=dropEveryNthItem_6)
endPoint_17 = Curve.EndPoint(curve=dropEveryNthItem_6)
byTwoPoints_11 = Vector.ByTwoPoints(start=startPoint_18, end=endPoint_17)
project_11 = Point.Project(point=pointAtParameter_8, baseGeometry=dropEveryNthItem_5, projectionDirection=byTwoPoints_11)
byStartPointEndPoint_12 = Line.ByStartPointEndPoint(startPoint=project_11, endPoint=pointAtParameter_8)
dropEveryNthItem_7 = List.DropEveryNthItem(list=flatten_47, n=code_block_47.out0, offset=code_block_47.out1)
startPoint_19 = Curve.StartPoint(curve=dropEveryNthItem_7)
endPoint_18 = Curve.EndPoint(curve=dropEveryNthItem_7)
byTwoPoints_12 = Vector.ByTwoPoints(start=startPoint_19, end=endPoint_18)
project_12 = Point.Project(point=pointAtParameter_8, baseGeometry=dropEveryNthItem_5, projectionDirection=byTwoPoints_12)
byStartPointEndPoint_13 = Line.ByStartPointEndPoint(startPoint=project_12, endPoint=pointAtParameter_8)
list_create_24 = List.Create(item0=byStartPointEndPoint_12, item1=byStartPointEndPoint_13)
transpose_12 = List.Transpose(lists=list_create_24)
clean_4 = List.Clean(list=transpose_12, preserveIndices=boolean)
flatten_48 = List.Flatten(list=clean_4, amount=code_block_48)
startPoint_20 = Curve.StartPoint(curve=flatten_48)
endPoint_19 = Curve.EndPoint(curve=flatten_48)
list_create_25 = List.Create(item0=startPoint_20, item1=endPoint_19)
transpose_13 = List.Transpose(lists=list_create_25)
flatten_49 = List.Flatten(list=transpose_13)
code_block_132 = CodeBlock(sidelineA=dropEveryNthItem_6, sidelineB=dropEveryNthItem_7) { sidelineA; sidelineB; }

# group: Filtering Edge Plot Surfaces
python_script = Python(IN[0]=flatten_48)  # IronPython2
# ---------- python_script.python (23 lines) ----------
# Enable Python support and load DesignScript library
import clr
clr.AddReference('ProtoGeometry')
from Autodesk.DesignScript.Geometry import *

# The inputs to this node will be stored as a list in the IN variables.
list1 = IN[0]

outlist = []
for x in list1:
	outlist.append([])
	for y in x:
		if type(y) is list:
			for z in y:
				outlist[-1].append(z)
		else:
			outlist[-1].append(y)

# Place your code below this line

# Assign your output to the OUT variable.
# OUT = flattenlist(list2)
OUT = outlist
# ----------------------------------------
split_6 = Geometry.Split(geometry=code_block_123, other=python_script)
flatten_50 = List.Flatten(list=split_6@L3)
area_3 = Surface.Area(surface=flatten_50)
minimumItem_4 = List.MinimumItem(list=area_3)
eq_13 = area_3 == minimumItem_4
filterByBoolMask_17 = List.FilterByBoolMask(list=flatten_50, mask=eq_13)

takeEveryNthItem_25 = List.TakeEveryNthItem(list=python_script@L2, n=code_block_50.out0, offset=code_block_50.out2)
startPoint_21 = Curve.StartPoint(curve=takeEveryNthItem_25)
endPoint_20 = Curve.EndPoint(curve=takeEveryNthItem_25)
list_create_26 = List.Create(item0=startPoint_21, item1=endPoint_20)
transpose_14 = List.Transpose(lists=list_create_26)
transpose_15 = List.Transpose(lists=transpose_14@L3)
takeEveryNthItem_26 = List.TakeEveryNthItem(list=python_script@L2, n=code_block_50.out0, offset=code_block_50.out1)
endPoint_21 = Curve.EndPoint(curve=takeEveryNthItem_26)
startPoint_22 = Curve.StartPoint(curve=takeEveryNthItem_26)
list_create_27 = List.Create(item0=endPoint_21, item1=startPoint_22)
transpose_16 = List.Transpose(lists=list_create_27)
transpose_17 = List.Transpose(lists=transpose_16@L3)
list_create_28 = List.Create(item0=transpose_15, item1=transpose_17)
transpose_18 = List.Transpose(lists=list_create_28)
chop_10 = List.Chop(list=transpose_18@L2, lengths=code_block_51)
laceLongest = List.LaceLongest(combineFunction=join, list0=takeEveryNthItem_25, list1=takeEveryNthItem_26)
deconstruct_2 = List.Deconstruct(list=python_script@L2)
list_create_29 = List.Create(item0=deconstruct_2.rest)
takeEveryNthItem_27 = List.TakeEveryNthItem(list=list_create_29@L2, n=code_block_52.out0, offset=code_block_52.out1)
startPoint_23 = Curve.StartPoint(curve=takeEveryNthItem_27)
endPoint_22 = Curve.EndPoint(curve=takeEveryNthItem_27)
list_create_30 = List.Create(item0=startPoint_23, item1=endPoint_22)
transpose_19 = List.Transpose(lists=list_create_30)
transpose_20 = List.Transpose(lists=transpose_19@L3)
takeEveryNthItem_28 = List.TakeEveryNthItem(list=list_create_29@L2, n=code_block_52.out0, offset=code_block_52.out2)
endPoint_23 = Curve.EndPoint(curve=takeEveryNthItem_28)
startPoint_24 = Curve.StartPoint(curve=takeEveryNthItem_28)
list_create_31 = List.Create(item0=endPoint_23, item1=startPoint_24)
transpose_21 = List.Transpose(lists=list_create_31)
transpose_22 = List.Transpose(lists=transpose_21@L3)
list_create_32 = List.Create(item0=transpose_20, item1=transpose_22)
transpose_23 = List.Transpose(lists=list_create_32)
chop_11 = List.Chop(list=transpose_23@L2, lengths=code_block_53)
laceLongest_2 = List.LaceLongest(combineFunction=join_2, list0=takeEveryNthItem_27, list1=takeEveryNthItem_28)
list_create_33 = List.Create(item0=filterByBoolMask_17.in)
code_block_133 = CodeBlock(PlotSurfaces1=list_create_33) { PlotSurfaces1; }
transpose_24 = List.Transpose(lists=transpose_18@L4)
flatten_51 = List.Flatten(list=transpose_24@L3)
count = List.Count(list=flatten_51@L2)
le = count <= code_block_54
filterByBoolMask_18 = List.FilterByBoolMask(list=flatten_51@L3, mask=le)
byPoints_7 = Polygon.ByPoints(points=filterByBoolMask_18.out)
ꟿ_polygon_2darea = Custom[ꟿ Polygon.2DArea](polygon=byPoints_7)  # package spring nodes; Returns the planar area of the input polygon(s). Not accurate for self-intersecting polys.
eq_14 = ꟿ_polygon_2darea == code_block_55
filterByBoolMask_19 = List.FilterByBoolMask(list=byPoints_7, mask=eq_14)
byPatch_6 = Surface.ByPatch(closedCurve=filterByBoolMask_19.out)
transpose_25 = List.Transpose(lists=transpose_23@L4)
flatten_52 = List.Flatten(list=transpose_25@L3)
count_2 = List.Count(list=flatten_52@L2)
le_2 = count_2 <= code_block_56
filterByBoolMask_20 = List.FilterByBoolMask(list=flatten_52@L3, mask=le_2)
byPoints_8 = Polygon.ByPoints(points=filterByBoolMask_20.out)
ꟿ_polygon_2darea_2 = Custom[ꟿ Polygon.2DArea](polygon=byPoints_8)
eq_15 = ꟿ_polygon_2darea_2 == code_block_57
filterByBoolMask_21 = List.FilterByBoolMask(list=byPoints_8, mask=eq_15)
byPatch_7 = Surface.ByPatch(closedCurve=filterByBoolMask_21.out)
list_create_34 = List.Create(item0=code_block_133, item1=byPatch_6, item2=byPatch_7)
flatten_53 = List.Flatten(list=list_create_34)

# group: Create Individual plot Surface
perimeterCurves_6 = Surface.PerimeterCurves(surface=flatten_53)
code_block_134 = CodeBlock { 2; 1; }
takeEveryNthItem_29 = List.TakeEveryNthItem(list=perimeterCurves_6@L2, n=code_block_134.out0, offset=code_block_134.out1)
code_block_135 = CodeBlock { 2; 1; }
takeEveryNthItem_30 = List.TakeEveryNthItem(list=takeEveryNthItem_29@L2, n=code_block_135.out0, offset=code_block_135.out1)
code_block_136 = CodeBlock { 0.5; }
pointAtParameter_9 = Curve.PointAtParameter(curve=takeEveryNthItem_30, param=code_block_136)
code_block_137 = CodeBlock { 2; 0; }
takeEveryNthItem_31 = List.TakeEveryNthItem(list=takeEveryNthItem_29@L2, n=code_block_137.out0, offset=code_block_137.out1)
code_block_138 = CodeBlock { 2; 0; }
takeEveryNthItem_32 = List.TakeEveryNthItem(list=perimeterCurves_6@L2, n=code_block_138.out0, offset=code_block_138.out1)
code_block_139 = CodeBlock { 2; 1; }
takeEveryNthItem_33 = List.TakeEveryNthItem(list=takeEveryNthItem_32@L2, n=code_block_139.out0, offset=code_block_139.out1)
startPoint_25 = Curve.StartPoint(curve=takeEveryNthItem_33)
endPoint_24 = Curve.EndPoint(curve=takeEveryNthItem_33)
byTwoPoints_13 = Vector.ByTwoPoints(start=startPoint_25, end=endPoint_24)
project_13 = Point.Project(point=pointAtParameter_9, baseGeometry=takeEveryNthItem_31, projectionDirection=byTwoPoints_13)
byStartPointEndPoint_14 = Line.ByStartPointEndPoint(startPoint=project_13, endPoint=pointAtParameter_9)
split_7 = Geometry.Split(geometry=flatten_53, other=byStartPointEndPoint_14)

# group: Building Blocks
flatten_54 = List.Flatten(list=split_7)
perimeterCurves_7 = Surface.PerimeterCurves(surface=flatten_54)
startPoint_26 = Curve.StartPoint(curve=perimeterCurves_7)
endPoint_25 = Curve.EndPoint(curve=perimeterCurves_7)
list_create_35 = List.Create(item0=startPoint_26, item1=endPoint_25)
transpose_26 = List.Transpose(lists=list_create_35)
flatten_55 = List.Flatten(list=transpose_26)
code_block_140 = CodeBlock { 4; }
chop_12 = List.Chop(list=flatten_55, lengths=code_block_140)
byPoints_9 = Polygon.ByPoints(points=chop_12)
code_block_141 = CodeBlock { 2; 1; }
takeEveryNthItem_34 = List.TakeEveryNthItem(list=byPoints_9, n=code_block_141.out0, offset=code_block_141.out1)
offset_9 = Curve.Offset(curve=takeEveryNthItem_34, distance=code_block_58)
ZAxis_2 = Vector.ZAxis()
count_3 = List.Count(list=takeEveryNthItem_34)
number_slider_2 = DoubleSlider(9, range=0..100 step 1)
number_slider_3 = DoubleSlider(15, range=0..100 step 1)
number_slider_4 = DoubleSlider(2, range=0..100 step 1)
randomList = Math.RandomList(amount=count_3, value1=number_slider_2, value2=number_slider_3, seed=number_slider_4)
round_15 = Math.Round(number=randomList)
extrudeAsSolid = Curve.ExtrudeAsSolid(curve=offset_9, direction=ZAxis_2, distance=round_15)

takeItems = List.TakeItems(list=flatten_36, amount=code_block_41)
code_block_142 = CodeBlock(a=gt, b=takeItems, c=deconstruct.first) { (a?b:c); }
perimeterCurves_8 = Surface.PerimeterCurves(surface=code_block_142)
startPoint_27 = Curve.StartPoint(curve=perimeterCurves_8)
endPoint_26 = Curve.EndPoint(curve=perimeterCurves_8)
list_create_36 = List.Create(item0=startPoint_27, item1=endPoint_26)
transpose_27 = List.Transpose(lists=list_create_36)
byPoints_10 = Polygon.ByPoints(points=transpose_27)
flatten_56 = List.Flatten(list=byPoints_10)
takeEveryNthItem_35 = List.TakeEveryNthItem(list=flatten_56, n=code_block_59.out0, offset=code_block_59.out1)
offset_10 = Curve.Offset(curve=takeEveryNthItem_35, distance=code_block_60)
extrudeAsSolid_2 = Curve.ExtrudeAsSolid(curve=offset_10, direction=ZAxis, distance=code_block_61)

# group: All Site Objects
code_block_143 = CodeBlock(allbuildings=extrudeAsSolid) { allbuildings; }
code_block_144 = CodeBlock(gardensurfaces=list_create_22) { gardensurfaces; }
code_block_145 = CodeBlock(innerplotsurfaces=filterByBoolMask_13.out) { innerplotsurfaces; }
code_block_146 = CodeBlock(schoolplotsurface=deconstruct.first) { schoolplotsurface; }
code_block_147 = CodeBlock(AllRoadSurfaces=code_block_121) { AllRoadSurfaces; }
code_block_148 = CodeBlock(schoolbuilding=extrudeAsSolid_2) { schoolbuilding; }

# group: VISUALIZE
color_palette_2 = ColorPalette({R: 137, G: 137, B: 137, A: 150})
byGeometryColor = Modifiers.GeometryColor.ByGeometryColor(geometry=code_block_143, color=color_palette_2)
color_palette_3 = ColorPalette({R: 0, G: 255, B: 28, A: 190})
byGeometryColor_2 = Modifiers.GeometryColor.ByGeometryColor(geometry=code_block_144, color=color_palette_3)
color_palette_4 = ColorPalette({R: 128, G: 128, B: 128, A: 190})
byGeometryColor_3 = Modifiers.GeometryColor.ByGeometryColor(geometry=code_block_145, color=color_palette_4)
color_palette_5 = ColorPalette({R: 0, G: 255, B: 28, A: 190})
byGeometryColor_4 = Modifiers.GeometryColor.ByGeometryColor(geometry=code_block_146, color=color_palette_5)
color_palette_6 = ColorPalette({R: 255, G: 255, B: 255, A: 250})
byGeometryColor_5 = Modifiers.GeometryColor.ByGeometryColor(geometry=code_block_147, color=color_palette_6)  # frozen
byGeometryColor_6 = Modifiers.GeometryColor.ByGeometryColor(geometry=code_block_148, color=color_palette_2)

# group: Open Space Area
flatten_57 = List.Flatten(list=sum_2)
code_block_149 = CodeBlock(OpenSpaceArea=flatten_57) { OpenSpaceArea; }
deconstruct_3 = List.Deconstruct(list=code_block_149)
round_16 = Math.Round(number=deconstruct_3.first)
open_space_area = Watch(round_16)

# group: Road Area
code_block_150 = CodeBlock(AllRoadSurfaces=code_block_147) { AllRoadSurfaces; }
area_4 = Surface.Area(surface=code_block_150)
round_17 = Math.Round(number=area_4)
road_area = Watch(round_17)

# group: Percentage of road shaded
code_block_151 = CodeBlock(Allroadsurface=code_block_147) { Allroadsurface; }
code_block_152 = CodeBlock(buildingpolygons=offset_9) { buildingpolygons; }
ZAxis_3 = Vector.ZAxis()
translate = Geometry.Translate(geometry=code_block_152, direction=ZAxis_3, distance=round_15)
current = SunSettings()  # "SunSettings.Current"
sunDirection = SunSettings.SunDirection(sunSettings=current)
boolean_3 = BoolSelector(false)
area_5 = Surface.Area(surface=code_block_151)

remember_3 = Data.Remember(sunDirection)

# group (continued): Percentage of road shaded
projectInputOnto = Surface.ProjectInputOnto(surface=code_block_151, geometryToProject=translate, projectionDirection=remember_3)
clean_5 = List.Clean(list=projectInputOnto, preserveIndices=boolean_3)
byJoinedCurves = PolyCurve.ByJoinedCurves(curves=clean_5)
extrudeAsSolid_3 = Curve.ExtrudeAsSolid(curve=byJoinedCurves)
byUnion_4 = Solid.ByUnion(solids=extrudeAsSolid_3)
intersect = Geometry.Intersect(geometry=byUnion_4, other=code_block_151)
byUnion_5 = Surface.ByUnion(surfaces=intersect)
area_6 = Surface.Area(surface=byUnion_5)
code_block_153 = CodeBlock(a=area_6, b=area_5) { (a/b)*100; }

byGeometryColor_7 = Modifiers.GeometryColor.ByGeometryColor(geometry=byUnion_5, color=color_palette)

# group: Percentage Open Space
flatten_58 = List.Flatten(list=code_block_122)
code_block_154 = CodeBlock(OpenSpaceAreaPercentage=flatten_58) { OpenSpaceAreaPercentage; }
deconstruct_4 = List.Deconstruct(list=code_block_154)
round_18 = Math.Round(number=deconstruct_4.first)
open_space_area_percentage = Watch(round_18)  # graph output

code_block_155 = CodeBlock(percentageopenspace=open_space_area_percentage) { percentageopenspace; }

# group: No. of Plots
count_4 = List.Count(list=extrudeAsSolid)
code_block_156 = CodeBlock(NumberofPlots=count_4) { NumberofPlots; }
no_of_plots = Watch(code_block_156)  # graph output

code_block_157 = CodeBlock(NumberofPlots=no_of_plots) { NumberofPlots; }

# group: Road Area Percentage
code_block_158 = CodeBlock(AllRoadSurfaces=code_block_147) { AllRoadSurfaces; }
area_7 = Surface.Area(surface=code_block_158)
code_block_159 = CodeBlock(sitesurface=code_block_5) { sitesurface; }
area_8 = Surface.Area(surface=code_block_159)
code_block_160 = CodeBlock(a=area_7, b=area_8) { (a/b)*100; }
round_19 = Math.Round(number=code_block_160)
percentage_road_area = Watch(round_19)  # graph output

code_block_161 = CodeBlock(percentageroadarea=percentage_road_area) { percentageroadarea; }

# group: Proximity to School
code_block_162 = CodeBlock { 0.5; 0.5; }
pointAtParameter_10 = Surface.PointAtParameter(surface=code_block_146, u=code_block_162.out0, v=code_block_162.out1)
center_2 = Polygon.Center(polygon=takeEveryNthItem_34)
byStartPointEndPoint_15 = Line.ByStartPointEndPoint(startPoint=pointAtParameter_10, endPoint=center_2)
length_12 = Curve.Length(curve=byStartPointEndPoint_15)
maximumItem_6 = List.MaximumItem(list=length_12)
round_20 = Math.Round(number=maximumItem_6)
maximum_radial_distance_to = Watch(round_20)  # "Maximum Radial Distance to School"; graph output

code_block_163 = CodeBlock(Proximitytoschool=maximum_radial_distance_to) { Proximitytoschool; }

# group: Maximum Radial Distance to Park
code_block_164 = CodeBlock(majorplots=code_block_92) { majorplots; }
doesIntersect_2 = Geometry.DoesIntersect(geometry=code_block_164, other=code_block_144, lacing=CrossProduct)
filterByBoolMask_22 = List.FilterByBoolMask(list=code_block_144, mask=doesIntersect_2@L3)
list_create_37 = List.Create(item0=filterByBoolMask_22.in)
flatten_59 = List.Flatten(list=list_create_37)
code_block_165 = CodeBlock { 0.5; }
pointAtParameter_11 = Surface.PointAtParameter(surface=flatten_59, u=code_block_165, v=code_block_165)
doesIntersect_3 = Geometry.DoesIntersect(geometry=code_block_164, other=takeEveryNthItem_34, lacing=CrossProduct)
filterByBoolMask_23 = List.FilterByBoolMask(list=takeEveryNthItem_34, mask=doesIntersect_3@L2)
center_3 = Polygon.Center(polygon=filterByBoolMask_23.in)
byStartPointEndPoint_16 = Line.ByStartPointEndPoint(startPoint=pointAtParameter_11, endPoint=center_3)
flatten_60 = List.Flatten(list=byStartPointEndPoint_16)
length_13 = Curve.Length(curve=flatten_60)
round_21 = Math.Round(number=length_13)
maximumItem_7 = List.MaximumItem(list=round_21)
maximum_radial_distance_to_park = Watch(maximumItem_7)  # graph output

code_block_166 = CodeBlock(Proximitytoopenspace=maximum_radial_distance_to_park) { Proximitytoopenspace; }
round_22 = Math.Round(number=code_block_153)

# group (continued): Percentage of road shaded
percentage_of_road_shaded = Watch(round_22)  # graph output

code_block_167 = CodeBlock(Percentageshadow=percentage_of_road_shaded) { Percentageshadow; }
list_create_38 = List.Create(item0=code_block_155, item1=code_block_157, item2=code_block_161, item3=code_block_163, item4=code_block_166, item5=code_block_167)
code_block_168 = CodeBlock(combinedmetrics=list_create_38) { combinedmetrics; }

# group: Analysis Text Values
code_block_169 = CodeBlock { x = 0; y = 250; height = 10; }
code_block_170 = CodeBlock(metricnames=code_block_64) { metricnames; }
code_block_171 = CodeBlock(names=code_block_170) { names; }
count_5 = List.Count(list=code_block_171)
code_block_172 = CodeBlock(count=count_5) { 1..count; }
string_from_object = FromObject(object=code_block_172)
code_block_173 = CodeBlock(values=code_block_168) { values; }
string_from_object_2 = FromObject(object=code_block_173)
code_block_174 = CodeBlock { 10; }

# group: Graph
x_offset = DoubleSlider(70, range=0..115 step 1)
add = code_block_169.x + x_offset
y_offset = DoubleSlider(197, range=0..250 step 1)
sub = code_block_169.y - y_offset
byCoordinates = Point.ByCoordinates(x=add, y=sub)
code_block_175 = CodeBlock(position=byCoordinates) { position; }
size = DoubleSlider(80, range=0..100 step 0.1)
code_block_176 = CodeBlock { bands = 4; }
code_block_177 = CodeBlock(size=size, bands=code_block_176)
# ---------- code_block_177.designscript (5 lines) ----------
rng = ToString(size/bands);
len = String.Length(rng);
str = String.Remove(rng, len-1, 1);
inc = String.ToNumber(str);
0..size..inc;
# ----------------------------------------
restOfItems = List.RestOfItems(list=code_block_177.out4)
byCenterPointRadius = Circle.ByCenterPointRadius(centerPoint=code_block_175, radius=restOfItems)
code_block_178 = CodeBlock { metricmins = [0, 0, 50, 1000, 500, 0]; }
code_block_179 = CodeBlock { metricmaxs = [50, 1000, 0, 0, 0, 50]; }
map = Math.Map(rangeMin=code_block_178, rangeMax=code_block_179, inputValue=code_block_168)
code_block_180 = CodeBlock(normalizedmetrics=map) { normalizedmetrics; }
count_6 = List.Count(list=code_block_180)
regularPolygon = Polygon.RegularPolygon(circle=byCenterPointRadius, numberSides=count_6)
ZAxis_4 = Vector.ZAxis()
code_block_181 = CodeBlock { 90; }
rotate = Geometry.Rotate(geometry=regularPolygon, origin=code_block_175, axis=ZAxis_4, degrees=code_block_181)
lastItem = List.LastItem(list=rotate)
points = Polygon.Points(polygon=lastItem)
byStartPointEndPoint_17 = Line.ByStartPointEndPoint(startPoint=code_block_175, endPoint=points)
reverse = List.Reverse(list=rotate)
restOfItems_2 = List.RestOfItems(list=reverse)
join_3 = List.Join(list0=byStartPointEndPoint_17, list1=restOfItems_2)
pointAtParameter_12 = Curve.PointAtParameter(curve=byStartPointEndPoint_17, param=code_block_180)
byPoints_11 = Polygon.ByPoints(points=pointAtParameter_12)
byPatch_8 = Surface.ByPatch(closedCurve=byPoints_11)
color_palette_7 = ColorPalette({R: 92, G: 250, B: 255, A: 222})
byGeometryColor_8 = Modifiers.GeometryColor.ByGeometryColor(geometry=byPatch_8, color=color_palette_7)
code_block_182 = CodeBlock(count=count_6) { 1..count; }
string_from_object_3 = FromObject(object=code_block_182)
code_block_183 = CodeBlock { 12; }

offset_11 = Curve.Offset(curve=lastItem, distance=code_block_63)
ꟿ_polycurve_points = Custom[ꟿ PolyCurve.Points](polyCurve=offset_11)  # package spring nodes; Gets all the unique start and end points of the underlying curves in a sorted list.
fromStringOriginAndScale = DynamoText.Text.FromStringOriginAndScale(text=string_from_object_3, origin=ꟿ_polycurve_points, scale=code_block_183)
list_create_39 = List.Create(item0=fromStringOriginAndScale, item1=byStartPointEndPoint_17, item2=restOfItems_2, item3=lastItem)

# group (continued): Analysis Text Values
code_block_184 = CodeBlock(index=string_from_object, name=code_block_171, value=string_from_object_2, valueofparameter=map, offset=code_block_169.x, start=code_block_169.y, height=code_block_169.height, i=code_block_172) { index + ". " + name + ": " + value + ": " + valueofparameter; Point.ByCoordinates(offset, start-(height + (12*i-1))); }

fromStringOriginAndScale_2 = DynamoText.Text.FromStringOriginAndScale(text=code_block_184.out0, origin=code_block_184.out1, scale=code_block_174)
